vi "BER.gvi"   [LabVIEW NXG 3.0.0]
inputs:
  "Output bit stream": i8[]
  "Input bit stream": i8[]
  "error in": error
  "Array in": f64[]
  "Reset BER": bool
outputs:
  "error out": error
  "current BER": f64
  "BER array": f64[]
  "Mean_BER": f64
  "BER graph": f64[]
  "Correct Size": bool
  "Output array size": i32
  "Input array size": i32
uses:
  NI::Analysis::Statistics::Mean (DBL).gvi
  NI::G Core::Error::Filter Error Code.gvi
diagram:
  Array Size(array=$"Output bit stream") -> (size(s)=w1)
  # Check if input sequence has expected length
  $"Output array size" <- w1
  Array Size(array=$"Input bit stream") -> (size(s)=w2)
  Is Equal(x=w1, y=w2) -> w3
  $"Correct Size" <- w3
  $"Input array size" <- w2
  Is Not Equal(x=$"Output bit stream", y=$"Input bit stream") -> w4
  Boolean To Integer(Boolean=w4) -> (0, 1=w5)
  # Calculate BER
  case ($"error in") {
    frame Error, Default {
      w6 = $"error in"
      w7 = -1
    }
    frame No Error {
      call "Mean (DBL).gvi"(x=w5, error in=$"error in") -> (mean=w7, error out=w6)
    }
  }
  $"current BER" <- w7
  case ($"Reset BER") {
    frame False, Default {
      w8 = $"Array in"
    }
    frame True {
      w8 = f64[] []
    }
  }
  Insert Into Array(inArray=w8, new=w7) -> w9
  $"BER graph" <- w9
  $"BER array" <- w9
  # Remove all values that are -1 from array. -1 is the value returned as BER when an error occured or no frame is detected.
  s1 = w9  # shift register
  while {
    Search 1D Array(1D array=s1, element=-1) -> (index of element=w10)
    Delete From Array(inArray=s1, index0=w10) -> w11
    Is Equal(x=w10, y=-1) -> w12
    next s1 = w11
    stop if w12
  }
  call "Filter Error Code.gvi"(error in=w6, code to clear=-20003) -> (error out=w13)
  call "Mean (DBL).gvi"(x=s1, error in=w13) -> (mean=w14, error out=w15)
  $Mean_BER <- w14
  $"error out" <- w15
