vi "BarkerCode.gvi"   [LabVIEW NXG 3.0.0]
inputs:
  "barker code": enum{"5", "7", "11", "random"} = "random"
outputs:
  "code": f64[]
  "length of one subcode": i32
  "subcodes": i32
panel indicators:
  "32-bit integer": i32
uses:
  NI::Analysis::Probability::Bernoulli Random.gvi
diagram:
  # Barker code
  case ($"barker code") {
    frame "5" {
      w1 = [1, 1, 1, -1, 1]
      w2 = default
      w3 = default
    }
    frame "7" {
      w1 = [1, 1, 1, -1, -1, 1, -1]
      w2 = default
      w3 = default
    }
    frame "11", Default {
      w1 = [1, 1, 1, -1, -1, -1, 1, -1, -1, 1, -1]
      w2 = default
      w3 = default
    }
    frame "random" {
      call "Bernoulli Random.gvi"(samples=100, p=0.5, seed=1, reset=TRUE) -> (Bernoulli random data=w4)
      To Long Integer(number=w4) -> w5
      Multiply(w5, 2) -> w6
      Decrement(x=w6) -> w7
      To Double Precision Float(number=w7) -> w1
      w2 = 2
      w3 = 100
    }
  }
  case ($"barker code") {
    frame Default {
      Reverse 1D Array(array=w1) -> (reversed array=w11)
      Build Array(w1, w11) -> w8
      Array Size(array=w1) -> (size(s)=w9)
      w10 = 2
    }
    frame "random" {
      Divide(x=w3, y=w2) -> w12: f64
      To Long Integer(number=w12) -> w9
      w8 = w1
      w10 = w2
    }
  }
  $code <- w8
  $subcodes <- w10
  $"length of one subcode" <- w9
  To Long Integer(number=$"barker code") -> w13
  $"32-bit integer" <- w13
