vi "Interleaver.gvi"   [LabVIEW NXG 3.0.0]
inputs:
  "data in": i32[]
  "error in": error
  "selector": enum{"TX", "RX", "TX Block", "RX Block"} = "TX"
outputs:
  "data out": i32[]
  "error out": error
uses:
  NI::Analysis::Probability::Random Permutation.gvi
  NI::Modulation::MT Permute.gvi
  NI::Modulation::MT DePermute.gvi
  NI::Modulation::MT Block Interleave (Matrix).gvi
  NI::Modulation::MT Block DeInterleave (Matrix).gvi
diagram:
  case ($selector) {
    frame "TX" {
      Array Size(array=$"data in") -> (size(s)=w3)
      call "Random Permutation.gvi"(n=w3, start=0, seed=1, error in=$"error in", reset=TRUE) -> (random permutation=w4, error out=w5)
      call "MT Permute.gvi"(data in=$"data in", permutation array=w4, error in=w5) -> (data out=w2, error out=w1)
    }
    frame "RX" {
      Array Size(array=$"data in") -> (size(s)=w6)
      call "Random Permutation.gvi"(n=w6, start=0, seed=1, error in=$"error in", reset=TRUE) -> (random permutation=w7, error out=w8)
      call "MT DePermute.gvi"(data in=$"data in", permutation array=w7, error in=w8) -> (data out=w2, error out=w1)
    }
    frame "TX Block" {
      call "MT Block Interleave (Matrix).gvi"(data in=$"data in", error in=$"error in") -> (data out=w2, error out=w1)
    }
    frame "RX Block" {
      call "MT Block DeInterleave (Matrix).gvi"(data in=$"data in", error in=$"error in") -> (data out=w2, error out=w1)
    }
  }
  $"data out" <- w2
  $"error out" <- w1
