vi "MSE.gvi"   [LabVIEW NXG 3.0.0]
inputs:
  "IQ Reference signal": c128[]
  "IQ Input signal": c128[]
  "error in": error
  "Array in": f64[]
  "Reset MSE": bool
outputs:
  "error out": error
  "Accumulated MSE": f64
  "MSE Array": f64[]
uses:
  NI::Analysis::Statistics::Mean (DBL).gvi
diagram:
  case ($"Reset MSE") {
    frame False, Default {
      w1 = $"Array in"
    }
    frame True {
      w1 = f64[] []
    }
  }
  Subtract(x=$"IQ Input signal", y=$"IQ Reference signal") -> w2
  Absolute Value(x=w2) -> w3
  Square(x=w3) -> w4
  call "Mean (DBL).gvi"(x=w4, error in=$"error in") -> (mean=w5, error out=w6)
  Insert Into Array(inArray=w1, new=w5) -> w7
  $"MSE Array" <- w7
  call "Mean (DBL).gvi"(x=w7) -> (mean=w8)
  $"Accumulated MSE" <- w8
  $"error out" <- w6
