vi "PowerEstimator.gvi"   [LabVIEW NXG 3.0.0]
inputs:
  "input signal": c128[]
outputs:
  "estimated power": f64
  "Power signal": f64[]
diagram:
  Absolute Value(x=$"input signal") -> w1
  Square(x=w1) -> w2
  $"Power signal" <- w2
  Array Size(array=$"input signal") -> (size(s)=w3)
  Add Array Elements(numeric array=w2) -> (sum=w4)
  Divide(x=w4, y=w3) -> w5
  $"estimated power" <- w5
