vi "FrameSync.gvi"   [LabVIEW NXG 3.0.0]
inputs:
  "input signal": c128[]
  "barker code": enum{"5", "7", "11", "random"} = "random"
  "sync frame index (symbols)": i32 = 16
  "samples per symbol": f64 = 16
  "sync frame buffer (symbols)": i32 = 16
  "error in": error
  "Min correlation": f64
outputs:
  "output signal": c128[]
  "max index": f64
  "Training Subcodes": c128[]
  "error out": error
  "Correlation": f64[]
uses:
  NI::Analysis::Operations::1D Cross Correlation (CDB).gvi
  NI::Analysis::Measurement::Threshold Detector (1D DBL).gvi
  NI::G Core::Error::Build Error Cluster.gvi
diagram:
  To Long Integer(number=$"samples per symbol") -> w1
  Multiply($"sync frame buffer (symbols)", w1) -> w2
  call "BarkerCode.gvi"(barker code=$"barker code") -> (code=w3, length of one subcode=w4, subcodes=w5)
  To Double Precision Complex(number=w3) -> w6
  # w5: subcode count
  call "Upsampler.gvi"(Signal in=w6, Samples per symbol=$"samples per symbol", error in=$"error in") -> (Upsampled signal=w7, error out=w8)
  Multiply($"sync frame index (symbols)", w1) -> w9
  # w10: index - buffer
  Subtract(x=w9, y=w2) -> w10
  # w4: length of one subcode
  Multiply(w4, w5) -> w11
  Multiply(w1, w11) -> w12
  # w11: sync frame length
  Multiply(w2, 2) -> w13
  # w14: length + 2*buffer
  Add(w13, w12) -> w14
  # Reduce the search area
  Array Subset(array=$"input signal", index0=w10, length0=w14) -> w15
  Array Size(array=w15) -> (size(s)=w16)
  Is Greater Than 0(x=w16) -> w17
  Decrement(x=w16) -> w18
  Initialize Array(element=0, size=w18) -> w19
  case (w17) {
    frame False, Default {
      w20 = w8
      w21 = f64[] []
      w22 = c128[][] []
      w23 = TRUE
    }
    frame True {
      s1 = w19  # shift register
      s2 = w8  # shift register
      for (N = w5) (iteration -> i1) {
        Array Size(array=w7) -> (size(s)=w24)
        call "Subcodemask.gvi"(input=w7, subcode length=w4, samples per symbol=$"samples per symbol", index=i1) -> (output=w25)
        # Moves the position of the subcode
        # so that the correlation indices overlap
        call "1D Cross Correlation (CDB).gvi"(x=w25, y=w15, error in=s2) -> (Rxy=w26, error out=w27)
        Array Subset(array=w26, index0=w24) -> w28
        Absolute Value(x=w28) -> w29
        Add(s1, w29) -> w30
        append w28 to w22
        next s1 = w30
        next s2 = w27
      }
      w20 = s2
      w21 = s1
      w23 = FALSE
    }
  }
  # Find index and value of max correlation
  # Perform cross correlation between the signal and each of the subcodes
  # TODO: take first correlation peak
  call "Threshold Detector (1D DBL).gvi"(location mode="Index"(0), signal=w21, threshold=$"Min correlation", error in=w20) -> (locations=w31, count=w32, error out=w33)
  Array Index(array=w31) -> (out0[0]=w34)
  Increment(x=w34) -> w35
  Subtract(x=w35, y=w2) -> w36
  # Shift the signal with the sync index
  Array Subset(array=$"input signal", index0=w36) -> w37
  $"output signal" <- w37
  $"max index" <- w35
  $Correlation <- w21
  # Creates array of the correlated
  # subcodes at the max correlation
  for {
    w38 = each element of w22
    Array Index(array=w38) -> (out0[w34]=w40)
    append w40 to w39
  }
  $"Training Subcodes" <- w39
  Is Less Or Equal To 0(x=w32) -> w41
  Logical Or(w41, w23) -> w42
  # Throws an error if the correlation is below a threshold
  case (w42) {
    frame False, Default {
      w43 = w33
    }
    frame True {
      call "Build Error Cluster.gvi"(error in=w33, code=1234567, description="Frame sync failed") -> (error out=w43)
    }
  }
  $"error out" <- w43
