vi "FreqSync.gvi"   [LabVIEW NXG 3.0.0]
inputs:
  "input": c128[]
  "Training codes": c128[][]
  "Samples per symbol": f64 = 1
  "error in": error
  "barker code": enum{"5", "7", "11", "random"} = "random"
  "Frame index": i32
outputs:
  "output": c128[]
  "error out": error
  "phase drift": f64
  "intercept": f64
  "phase offset": f64
  "correction angles": f64[]
panel indicators:
  "best linear fit": f64[]
uses:
  NI::Analysis::Statistics::Median.gvi
  NI::Analysis::Generation::Ramp Pattern by Samples.gvi
  NI::Analysis::Conditioning::Unwrap Phase.gvi
  NI::Analysis::Fitting::Linear Fit.gvi
  NI::Analysis::Geometry::Wrap Angle (Scalar DBL).gvi
diagram:
  Array Index(array=$"Training codes") -> (out0[0, _]=w1)
  Array Size(array=$"Training codes") -> (size(s)=w2)
  Array Index(array=w2) -> (out0[0]=w3)
  Decrement(x=w3) -> w4
  for (N = w4) (iteration -> i1) {
    Increment(x=i1) -> w6
    Array Index(array=$"Training codes") -> (out0[w6, _]=w7)
    Quotient And Remainder(x=w6, y=2) -> (x-y*floor(x/y)=w8)
    Is Equal To 0(x=w8) -> w9
    case (w9) {
      frame False, Default {
        Reverse 1D Array(array=w7)
        w10 = w7
      }
      frame True {
        w10 = w7
      }
    }
    Array Size(array=w10) -> (size(s)=w11)
    Multiply(w11, w6) -> w12
    Complex Conjugate(x + iy=w1) -> w13
    Multiply(w13, w10) -> w14
    Add Array Elements(numeric array=w14) -> (sum=w15)
    Complex To Polar(r * e^(i*theta)=w15) -> (theta=w16)
    Divide(x=w16, y=w12) -> w17
    append w17 to w5
  }
  call "Median.gvi"(x=w5) -> (median=w18)
  $"phase drift" <- w18
  call "BarkerCode.gvi"(barker code=$"barker code") -> (subcodes=w19)
  disable {
    frame Enabled {
      w20 = default
      w21 = default
    }
    frame Disabled {
      Multiply(w19, $"Samples per symbol") -> w22
      call "Ramp Pattern by Samples.gvi"(samples=w19, end=w22, exclude end=TRUE) -> (ramp pattern=w23)
      Complex To Polar(r * e^(i*theta)=[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]) -> (theta=w24)
      call "Unwrap Phase.gvi"(input phase=w24, phase unit="radian in, radian out"(0), error in=$"error in") -> (unwrapped phase=w25, error out=w26)
      # Create a linear array for the x axis
      # Compensate for phase offset
      # Estimate phase offset between sub codes
      Divide(x=f64 default, y=4) -> w27
      Add(w25, w27) -> w28
      call "Linear Fit.gvi"(method="Least Square"(0), y=w28, x=w23, error in=w26) -> (best linear fit=w29, slope=w30, intercept=w31, error out=w20)
      # phase/subcode length
      $"best linear fit" <- w29
      $intercept <- w31
      Multiply($"Samples per symbol", $"Frame index") -> w32
      Multiply(w30, w32) -> w33
      Subtract(x=w31, y=w33) -> w34
      call "Wrap Angle (Scalar DBL).gvi"(angle=w34, wrapped angle range="-180 to 180 (-pi to pi)"(1), angle units="radian in, radian out"(0)) -> (wrapped angle=w21)
    }
  }
  Array Size(array=$input) -> (size(s)=w35)
  # n*phase/sub code length
  # from 0 to N
  Add(w35, 0) -> w36
  Multiply(w18, w36) -> w37
  # create phase compensation array
  call "Ramp Pattern by Samples.gvi"(samples=w36, end=w37, error in=w20) -> (ramp pattern=w38, error out=w39)
  Add(w38, w21) -> w40
  Negate(x=w40) -> w41
  Polar To Complex(r=1, theta=w41) -> (r * e^(i*theta)=w42)
  # compensate by multiplying with e^-j(n*phase/sub code length)
  Multiply($input, w42) -> w43
  $output <- w43
  # remove sync frame compensation
  $"error out" <- w39
  $"phase offset" <- w21
