vi "PacketDetector.gvi"   [LabVIEW NXG 3.0.0]
inputs:
  "input": c128[]
  "Power Threshold": f64 = 1e-07
  "index": i32
  "window length": i32
outputs:
  "detected?": bool
  "Calculated power": f64
diagram:
  To Double Precision Float(number=$"window length") -> w1
  # generate winow
  Array Subset(array=$input, index0=$index, length0=$"window length") -> w2
  Initialize Array(element=0, size=$"window length") -> w3
  # calculate mean power in window
  for {
    w4 = each element of w2
    w5 = each element of w3
    Absolute Value(x=w4) -> w7
    Square(x=w7) -> w8
    Add(w8, w5) -> w9
    append w9 to w6
  }
  Add Array Elements(numeric array=w6) -> (sum=w10)
  Divide(x=w10, y=w1) -> w11
  # frame if over threshold
  Is Greater(x=w11, y=$"Power Threshold") -> w12
  $"detected?" <- w12
  $"Calculated power" <- w11
