vi "PacketDetectorPreamble.gvi"   [LabVIEW NXG 3.0.0]
inputs:
  "input": c128[]
  "Correlation threshold": f64 = 1e-07
  "index": i32
  "error in": error
  "window length": i32
  "preamble code": enum{"5", "7", "11", "random"} = "random"
  "Samples per symbol": f64 = 1
outputs:
  "detected?": bool
  "max correlation": f64
  "error out": error
uses:
  NI::Analysis::Operations::1D Cross Correlation (CDB).gvi
diagram:
  call "BarkerCode.gvi"(barker code=$"preamble code", Concatinate?=FALSE) -> (code=w1)
  To Double Precision Complex(number=w1) -> w2
  call "Upsampler.gvi"(Signal in=w2, Samples per symbol=$"Samples per symbol", error in=$"error in") -> (Upsampled signal=w3, error out=w4)
  # generate winow
  Array Subset(array=$input, index0=$index, length0=$"window length") -> w5
  call "1D Cross Correlation (CDB).gvi"(x=w3, y=w5, normalization="none", error in=w4) -> (Rxy=w6, error out=w7)
  Absolute Value(x=w6) -> w8
  Array Max And Min(array=w8) -> (max value=w9)
  # frame if over threshold
  Is Greater(x=w9, y=$"Correlation threshold") -> w10
  $"detected?" <- w10
  $"max correlation" <- w9
  $"error out" <- w7
