vi "Receiver.gvi"   [LabVIEW NXG 3.0.0]
inputs:
  "Signal in": c128[]
  "error in": error
  "IQ rate": f64
  "Interleaver mode": enum{"TX", "RX", "TX Block", "RX Block"} = "TX"
  "message length (symbols)": i32 = 16
  "sync frame index (symbols)": i32 = 16
  "barker code": enum{"5", "7", "11", "random"} = "random"
  "Symbol rate (sym/s)": i32
  "Min correlation": f64
  "Frame sync": bool
  "Freq sync": bool
  "Interleaver": bool
  "decoding": bool
  "sync frame buffer (symbols)": i32 = 16
outputs:
  "output bit stream": i32[]
  "error out": error
  "Correlation": f64[]
  "IQ diagram": c128[]
  "Symbols downsampled (real)": f64[]
  "Baseband signal (real part)": cluster{"t0": f64, "dt": f64, "Y": f64[]}
  "Eye Diagram (real part)": cluster{"t0": f64, "dt": f64, "Y": f64[]}[]
uses:
  NI::G Core::Error::Filter Error Code.gvi
  NI::Modulation::MT Format Eye Diagram (complex).gvi
diagram:
  Divide(x=$"IQ rate", y=$"Symbol rate (sym/s)") -> w1
  To Long Integer(number=w1) -> w2
  # Matched filter
  call "NormalizeVector.gvi"(Vector=$"Signal in") -> (Normalized Vector=w3)
  # Frame synch
  case ($"Frame sync") {
    frame False, Default {
      w4 = f64[] []
      w5 = $"error in"
      w6 = w3
      w7 = c128[][] []
    }
    frame True {
      call "FrameSync.gvi"(input signal=w3, samples per symbol=w2, sync frame buffer (symbols)=$"sync frame buffer (symbols)", error in=$"error in", sync frame index (symbols)=$"sync frame index (symbols)", barker code=$"barker code", Min correlation=$"Min correlation") -> (output signal=w6, Correlation=w4, Training Subcodes=w7, error out=w5)
    }
  }
  Logical And($"Freq sync", $"Frame sync") -> w8
  # Frequency synch
  case (w8) {
    frame False, Default {
      w9 = w5
      w10 = w6
    }
    frame True {
      call "FreqSync.gvi"(input=w6, Training codes=w7, Samples per symbol=w2, Frame index=$"sync frame index (symbols)", error in=w5, barker code=$"barker code") -> (output=w10, error out=w9)
    }
  }
  # Downsample
  case ($"Frame sync") {
    frame False, Default {
      w11 = w10
    }
    frame True {
      call "RemoveSyncFrame.gvi"(input=w10, samples per symbol=w2, sync frame index (bits)=$"sync frame index (symbols)", barker code=$"barker code") -> (output=w11)
    }
  }
  call "Downsampler.gvi"(input signal=w11, error in=w9, samples per symbol=w2) -> (output signal=w12, error out=w13)
  case ($decoding) {
    frame False, Default {
      w14 = $"message length (symbols)"
    }
    frame True {
      Multiply(2, $"message length (symbols)") -> w14
    }
  }
  Array Subset(array=w12, index0=0, length0=w14) -> w15
  case (w13) {
    frame Error, Default {
      w16 = i8[] []
      w17 = w13
    }
    frame No Error {
      # Symbol mapping
      call "BPSKDemod.gvi"(symbols=w15, error in=w13) -> (output bit stream=w16, error out=w17)
    }
  }
  # Scrambler?
  call "FrameScrambler.gvi"(input=w16, error in=w17) -> (output=w18, error out=w19)
  case ($Interleaver) {
    frame False, Default {
      w20 = w18
      w21 = w19
    }
    frame True {
      call "Interleaver.gvi"(data in=w18, Message length=$"message length (symbols)", error in=w19, selector=$"Interleaver mode", Coding=$decoding) -> (data out=w20, error out=w21)
    }
  }
  case ($decoding) {
    frame False, Default {
      Array Subset(array=w20, length0=$"message length (symbols)") -> w22
      w23 = w21
    }
    frame True {
      # Decoding
      call "decode.gvi"(input data=w20, error in=w21) -> (output bit stream=w24, error out=w23)
      # trim remaining section
      Array Subset(array=w24, length0=$"message length (symbols)") -> w22
    }
  }
  $"output bit stream" <- w22
  $Correlation <- w4
  call "Filter Error Code.gvi"(error in=w23, code to clear=1234567) -> (error out=w25)
  # Ignore frame not found error
  $"error out" <- w25
  $"IQ diagram" <- w15
  Complex To Real Imaginary(x + iy=w15) -> (x=w26)
  $"Symbols downsampled (real)" <- w26
  Reciprocal(x=$"IQ rate") -> w27
  Complex To Real Imaginary(x + iy=w11) -> (x=w28)
  To Long Integer(number=w2) -> w29
  Multiply(w29, $"message length (symbols)") -> w30
  Array Subset(array=w28, length0=w30) -> w31
  # Plot signal
  Decimate Array(array=w31) -> (out1=w32)
  w33 = cluster{"t0": f64, "dt": f64, "Y": f64[]} {all zero or empty}
  Property Node(instance in=w33, "Y"=w32, "dt"=w27) -> (instance out=w34)  # Cluster Properties
  $"Baseband signal (real part)" <- w34
  call "MT Format Eye Diagram (complex).gvi"(waveform=w34, symbol rate=$"IQ rate", eye length=2) -> (eye diagram=w35)
  $"Eye Diagram (real part)" <- w35
