vi "ReceiverBlock.gvi"   [LabVIEW NXG 3.0.0]
panel controls:
  "IQ rate": f64 = 160000
  "carrier frequency": f64 = 915000000
  "gain (dB)": f64 = 10
  "active antenna": string = "RX2"
  "Device names": string = "USRP_06"
  "Stop_RX": bool
  "number of samples per USRP fetch": i64 = 20000
  "RF Channel": string = "1"
  "Symbol rate (sym/s)": i32 = 10000
  "filter parameter": f64 = 0.5
  "filter length": i32 = 8
  "message length (symbols)": i32 = 88
  "sync frame index (symbols)": i32 = 44
  "shift": bool
  "Power Threshold": f64 = 0.001
  "Min correlation": f64
  "Frame sync": bool = TRUE
  "Freq sync": bool = TRUE
  "barker code": enum{"5", "7", "11", "random"} = "random"
  "Stop_RX_2": bool
  "Reset BER": bool
  "decoding": bool
  "Receive sound": bool
  "Interleaver": bool
panel indicators:
  "actual IQ rate": f64
  "actual carrier frequency": f64
  "actual gain (dB)": f64
  "error out": error
  "enqueueing iteration": i32
  "dequeueing iteration": i32
  "Baseband signal (real)": cluster{"t0": f64, "dt": f64, "Y": f64[]}
  "IQ diagram": c128[]
  "Baseband signal (absolute value)": f64[]
  "Graph": f64[]
  "Power of signal": f64
  "samples/symbol": f64
  "sync frame correlation": f64[]
  "BER graph": f64[]
  "Mean_BER": f64
  "current BER": f64
  "Input array size": i32
  "Output array size": i32
  "Correct Size": bool
  "Symbols downsampled": f64[]
uses:
  NI::USRP::niUSRP Open Rx Session.gvi
  NI::USRP::niUSRP Configure Signal.gvi
  NI::USRP::niUSRP Initiate.gvi
  NI::USRP::niUSRP Fetch Rx Data (CDB).gvi
  NI::Analysis::Transforms::Complex FFT.gvi
  NI::USRP::niUSRP Abort.gvi
  NI::USRP::niUSRP Close Session.gvi
diagram:
  w1 = $"RF Channel"
  call "niUSRP Open Rx Session.gvi"(device names=$"Device names") -> (session handle out=w2, error out=w3)
  Property Node(instance in=w2, "niUSRP"=w1, error in=w3) -> (error out=w4, instance out=w5)
  call "niUSRP Configure Signal.gvi"(active antenna=$"active antenna", session handle=w5, error in=w4, IQ rate=$"IQ rate", carrier frequency=$"carrier frequency", gain=$"gain (dB)", channel list=w1) -> (session handle out=w6, error out=w7, coerced IQ rate=w8, coerced carrier frequency=w9, coerced gain=w10)
  call "niUSRP Initiate.gvi"(session handle=w6, error in=w7) -> (session handle out=w11, error out=w12)
  Obtain Queue(element data type=c128[] [], error in=w12) -> (error out=w13, queue out=w14)
  w15 = $"number of samples per USRP fetch"
  s1 = w13  # shift register
  s2 = w14  # shift register
  while (iteration -> i1) {
    # Producer loop
    call "niUSRP Fetch Rx Data (CDB).gvi"(session handle=w11, error in=s1, number of samples=w15, channel list=w1) -> (session handle out=w16, error out=w17, data=w18)
    Enqueue Element(element=w18, error in=w17, queue=s2) -> (error out=w19, queue out=w20, timed out?=w21)
    Logical Or(w19, w21, $Stop_RX) -> w22
    $"enqueueing iteration" <- i1
    next s1 = w19
    next s2 = w20
    stop if w22
  }
  s3 = w13  # shift register
  s4 = w14  # shift register
  s5 = uninitialised  # shift register
  while (iteration -> i2) {
    # Consumer loop
    Dequeue Element(error in=s3, queue=s4) -> (element=w23, error out=w24, queue out=w25)
    call "BusyChannelDetector.gvi"(channel input=w23, Threshold=$"Power Threshold") -> (busy channel=w26, estimated power=w27)
    case (w26) {
      frame False, Default {
        w28 = w24
        w29 = default
      }
      frame True {
        call "Receiver.gvi"(Interleaver=$Interleaver, Signal in=w23, filter length=$"filter length", filter parameter=$"filter parameter", IQ rate=w8, Symbol rate (sym/s)=$"Symbol rate (sym/s)", Min correlation=$"Min correlation", error in=w24, message length (symbols)=$"message length (symbols)", sync frame index (symbols)=$"sync frame index (symbols)", barker code=$"barker code", Frame sync=$"Frame sync", Freq sync=$"Freq sync", decoding=$decoding) -> (IQ diagram=w30, Symbols downsampled (real)=w31, output bit stream=w29, Correlation=w32, Baseband signal (real part)=w33, error out=w28)
        $"sync frame correlation" <- w32
        $"Baseband signal (real)" <- w33
        $"Symbols downsampled" <- w31
        $"IQ diagram" <- w30
      }
    }
    case ($"Receive sound") {
      frame False, Default {
        call "Example signal.gvi"(message length (bits)=$"message length (symbols)") -> (output bit stream=w36)
        call "BER.gvi"(Output bit stream=w29, Input bit stream=w36, Array in=s5, error in=w28, Reset BER=$"Reset BER") -> (Correct Size=w37, Output array size=w38, Input array size=w39, current BER=w40, Mean_BER=w41, BER graph=w42, BER array=w35, error out=w34)
        $"current BER" <- w40
        $Mean_BER <- w41
        $"BER graph" <- w42
        $"Input array size" <- w39
        $"Output array size" <- w38
        $"Correct Size" <- w37
      }
      frame True {
        call "Sink.gvi"(input bit stream=w29, error in=w28) -> (error out=w34)
        w35 = s5
      }
    }
    Logical Or(w34, $Stop_RX_2) -> w43
    Divide(x=w8, y=$"Symbol rate (sym/s)") -> w44
    $"samples/symbol" <- w44
    $"Power of signal" <- w27
    call "Complex FFT.gvi"(x=w23, shift?=$shift) -> (FFT{x}=w45)
    Absolute Value(x=w45) -> w46
    Logarithm Base 10(x=w46) -> w47
    $Graph <- w47
    Absolute Value(x=w23) -> w48
    $"Baseband signal (absolute value)" <- w48
    $"dequeueing iteration" <- i2
    next s3 = w34
    next s4 = w25
    next s5 = w35
    stop if w43
  }
  Release Queue(error in=s3, queue=s4) -> (error out=w49)
  call "niUSRP Abort.gvi"(session handle=w16, error in=w49) -> (session handle out=w50, error out=w51)
  call "niUSRP Close Session.gvi"(session handle=w50, error in=w51) -> (error out=w52)
  $"error out" <- w52
  $"actual IQ rate" <- w8
  $"actual carrier frequency" <- w9
  $"actual gain (dB)" <- w10
