vi "ReceiverBlock2.0.gvi"   [LabVIEW NXG 3.0.0]
panel controls:
  "IQ rate": f64 = 192000
  "carrier frequency": f64 = 2483000000
  "gain (dB)": f64 = 20
  "active antenna": string = "RX2"
  "Device names": string = "USRP_06"
  "RF Channel": string = "1"
  "Symbol rate (sym/s)": i32 = 12000
  "filter length": i32 = 8
  "message length (symbols)": i32 = 128
  "sync frame index (symbols)": i32 = 64
  "Power Threshold": f64 = 1e-07
  "Frame sync": bool = TRUE
  "Freq sync": bool = TRUE
  "barker code": enum{"5", "7", "11", "random"} = "11"
  "decoding": bool
  "Interleaver": bool = TRUE
  "number of samples per USRP fetch": i64 = 20000
  "Stop_RX_2": bool
  "Reset BER": bool
  "Receive sound": bool
  "window length": i32 = 100
  "Extra buffer backwards": i32 = 150
  "receiver on": bool = TRUE
  "Samples to append to next fetch": i32 = 100
  "preamble?": bool = TRUE
  "preamble code": enum{"5", "7", "11", "random"} = "7"
  "Correlation threshold": f64 = 0.2
  "Min correlation": f64 = 0.9
  "sync frame buffer (symbols)": i32 = 40
  "Reset MSE": bool
  "filter parameter": f64 = 0.5
  "Interleaver mode": enum{"TX", "RX", "TX Block", "RX Block"} = "RX"
panel indicators:
  "actual IQ rate": f64
  "actual carrier frequency": f64
  "actual gain (dB)": f64
  "error out": error
  "dequeueing iteration": i32
  "IQ diagram": c128[]
  "samples/symbol": f64
  "sync frame correlation": f64[]
  "enqueueing iteration": i32
  "size(s)": i32
  "number elements in queue": i32
  "current index": i32
  "one package": f64[]
  "BER graph": f64[]
  "Mean_BER": f64
  "current BER": f64
  "Input array size": i32
  "Output array size": i32
  "Correct Size": bool
  "Received packet in ASCII": string
  "Raw input": f64[]
  "max correlation": f64
  "MSE Graph": f64[]
  "Accumulated MSE": f64
  "preamble correlation": f64[]
  "FPS": f64
  "milliseconds": f64
uses:
  NI::USRP::niUSRP Open Rx Session.gvi
  NI::USRP::niUSRP Configure Signal.gvi
  NI::USRP::niUSRP Initiate.gvi
  NI::USRP::niUSRP Fetch Rx Data (CDB).gvi
  NI::Modulation::MT Pack Bits.gvi
  NI::USRP::niUSRP Abort.gvi
  NI::USRP::niUSRP Close Session.gvi
diagram:
  w1 = $"RF Channel"
  call "niUSRP Open Rx Session.gvi"(device names=$"Device names") -> (session handle out=w2, error out=w3)
  Property Node(instance in=w2, "niUSRP"=w1, error in=w3) -> (error out=w4, instance out=w5)
  call "niUSRP Configure Signal.gvi"(active antenna=$"active antenna", session handle=w5, error in=w4, IQ rate=$"IQ rate", carrier frequency=$"carrier frequency", gain=$"gain (dB)", channel list=w1) -> (session handle out=w6, error out=w7, coerced IQ rate=w8, coerced carrier frequency=w9, coerced gain=w10)
  call "niUSRP Initiate.gvi"(session handle=w6, error in=w7) -> (session handle out=w11, error out=w12)
  Obtain Notifier(element data type=bool TRUE, error in=w12, name="error") -> (error out=w13, notifier out=w14)
  Obtain Queue(element data type=c128[] [], error in=w13) -> (error out=w15, queue out=w16)
  w17 = $"number of samples per USRP fetch"
  s1 = w15  # shift register
  s2 = w16  # shift register
  while (iteration -> i1) {
    Get Notifier Status(notifier=w14) -> (latest notification=w18)
    # Producer loop
    case (w18) {
      frame True {
        w19 = w11
        w20 = s2
        w21 = s1
      }
      frame False {
        call "niUSRP Fetch Rx Data (CDB).gvi"(session handle=w11, error in=s1, number of samples=w17, channel list=w1) -> (session handle out=w19, error out=w22, data=w23)
        Enqueue Element(element=w23, error in=w22, queue=s2) -> (error out=w21, queue out=w20)
        call "NotifyError.gvi"(notifier ref=w14, error in=w21)
      }
    }
    $"enqueueing iteration" <- i1
    next s1 = w21
    next s2 = w20
    stop if w18
  }
  Obtain Queue(element data type=u8[] [], error in=w13) -> (error out=w24, queue out=w25)
  s3 = w15  # shift register
  s4 = w16  # shift register
  s5 = uninitialised  # shift register
  s6 = c128[] []  # shift register
  s7 = uninitialised  # shift register
  s8 = uninitialised  # shift register
  while (iteration -> i2) {
    Dequeue Element(error in=s3, queue=s4) -> (element=w26, queue out=w27)
    Get Queue Status(queue=w27) -> (# elements in queue=w28)
    $"number elements in queue" <- w28
    Insert Into Array(inArray=s6, new=w26) -> w29
    w30 = $"Symbol rate (sym/s)"
    To Double Precision Float(number=w30) -> w31
    Divide(x=w8, y=w31) -> w32
    call "PulseShaping.gvi"(Signal in=w29, Samples per symbol=w32, filter parameter=$"filter parameter", filter length=$"filter length", tx or rx="Rx") -> (signal out=w33)
    Array Size(array=w33) -> (size(s)=w34)
    # Consumer loop
    w35 = $"barker code"
    w36 = $"sync frame index (symbols)"
    w37 = $"message length (symbols)"
    To Double Precision Float(number=w30) -> w38
    Divide(x=w8, y=w38) -> w39
    call "BarkerCode.gvi"(barker code=w35) -> (code=w40)
    Array Size(array=w40) -> (size(s)=w41)
    Add(w37, w41) -> w42
    To Long Integer(number=w39) -> w43
    Multiply(w42, w43) -> w44
    Multiply(w44, 1) -> w45
    w46 = $"Extra buffer backwards"
    s9 = 0  # shift register
    s10 = s5  # shift register
    s11 = s7  # shift register
    s12 = 0  # shift register
    while {
      case ($"preamble?") {
        frame False, Default {
          call "PacketDetector.gvi"(input=w33, Power Threshold=$"Power Threshold", window length=$"window length") -> (detected?=w47)
          w48 = w15
          w49 = 0
        }
        frame True {
          call "PacketDetectorPreamble.gvi"(input=w33, Samples per symbol=w39, index=s9, error in=w15, Correlation threshold=$"Correlation threshold", window length=$"window length", preamble code=$"preamble code") -> (max index=w49, detected?=w47, correlation preamble=w50, max correlation=w51, error out=w48)
          $"preamble correlation" <- w50
          $"max correlation" <- w51
        }
      }
      Array Size(array=w33) -> (size(s)=w52)
      Add(w49, s9) -> w53
      Subtract(x=w53, y=w46) -> w54
      Is Greater Or Equal To 0(x=w54) -> w55
      # Add buffer
      case (w55) {
        frame False, Default {
          w56 = s9
        }
        frame True {
          w56 = w54
        }
      }
      Multiply(w46, 2) -> w57
      # w58: length + buffer
      # length to check
      Add(w57, w45) -> w58
      # w56: index - buffer
      case (w47) {
        frame False, Default {
          # w46: Extra buffer backwards
          # w60: next index
          Add($"window length", s9) -> w60
          Subtract(x=w52, y=w60) -> w66
          Is Less Or Equal To 0(x=w66) -> w59
          # check if done
          case (w59) {
            frame False, Default {
              w62 = c128[] []
            }
            frame True {
              Subtract(x=w52, y=$"Samples to append to next fetch") -> w67
              Array Subset(array=w29, index0=w67) -> w62
            }
          }
          w61 = w48
          w63 = s10
          w64 = s11
          w65 = s12
        }
        frame True {
          # select estimated package array
          Array Subset(array=w33, index0=w56, length0=w58) -> w68
          Add(s9, w58) -> w60
          Subtract(x=w52, y=w60) -> w69
          Is Less Or Equal To 0(x=w69) -> w70
          # if total frame, run receiver block
          # w52: length of fetch
          # check if total frame
          # w60: Index + frame length + buffer
          case (w70) {
            frame False, Default {
              case ($"receiver on") {
                frame False, Default {
                  w71 = i32[] []
                  w72 = w48
                  w73 = FALSE
                  w74 = c128[] []
                  w75 = FALSE
                }
                frame True {
                  call "Receiver.gvi"(Interleaver=$Interleaver, sync frame buffer (symbols)=$"sync frame buffer (symbols)", Interleaver mode=$"Interleaver mode", Signal in=w68, IQ rate=w8, Symbol rate (sym/s)=w30, Min correlation=$"Min correlation", error in=w48, message length (symbols)=w37, sync frame index (symbols)=w36, barker code=w35, Frame sync=$"Frame sync", Freq sync=$"Freq sync", decoding=$decoding) -> (IQ diagram=w74, output bit stream=w71, Correlation=w76, error out=w72)
                  $"IQ diagram" <- w74
                  $"sync frame correlation" <- w76
                  w73 = $decoding
                  w75 = $Interleaver
                }
              }
              case ($"Receive sound") {
                frame True {
                  Enqueue Element(element=w71, error in=w72, queue=w25) -> (error out=w61)
                  Array Size(array=w71) -> (size(s)=w77)
                  Is Greater Than 0(x=w77) -> w78
                  case (w78) {
                    frame False, Default { }
                    frame True {
                      call "MT Pack Bits.gvi"(input bit stream=w71, bits per integer=8, packed bit order="MSB first", integer format="Unsigned") -> (output integers=w79)
                      Byte Array To String(encoding="Extended ASCII", unsigned byte array=w79) -> (string=w80)
                      $"Received packet in ASCII" <- w80
                    }
                  }
                  w63 = f64[] []
                  w64 = f64[] []
                }
                frame False {
                  call "Example signal.gvi"(message length (bits)=w37) -> (output bit stream=w81)
                  case (w75) {
                    frame False, Default {
                      w82 = w81
                    }
                    frame True {
                      call "Interleaver.gvi"(data in=w81, Message length=w37, Coding=w73) -> (data out=w82)
                    }
                  }
                  call "FrameScrambler.gvi"(input=w82, error in=w72) -> (output=w83, error out=w84)
                  call "BPSKMod.gvi"(input bit stream=w83, error in=w84) -> (Symbol out=w85, error out=w86)
                  call "MSE.gvi"(Reset MSE=$"Reset MSE", IQ Input signal=w74, IQ Reference signal=w85, Array in=s11, error in=w86) -> (Accumulated MSE=w87, MSE Array=w64, error out=w88)
                  call "BER.gvi"(Output bit stream=w71, Input bit stream=w81, Array in=s10, error in=w88, Reset BER=$"Reset BER") -> (Correct Size=w89, Output array size=w90, Input array size=w91, current BER=w92, Mean_BER=w93, BER graph=w94, BER array=w63, error out=w61)
                  $"current BER" <- w92
                  $Mean_BER <- w93
                  $"BER graph" <- w94
                  $"Input array size" <- w91
                  $"Output array size" <- w90
                  $"Correct Size" <- w89
                  $"Accumulated MSE" <- w87
                  $"MSE Graph" <- w64
                }
              }
              Array Size(array=w68) -> (size(s)=w95)
              $"size(s)" <- w95
              Absolute Value(x=w68) -> w96
              $"one package" <- w96
              Increment(x=s12) -> w65
              w62 = c128[] []
            }
            frame True {
              # if not total frame, append to next fetch
              Array Subset(array=w29, index0=w56) -> w62
              w61 = w48
              w63 = s10
              w64 = s11
              w65 = s12
            }
          }
          # Stop while loop if checked whole fetch
          Subtract(x=w52, y=w60) -> w97
          # next index = current index + frame length +buffer
          Is Less Or Equal To 0(x=w97) -> w59
        }
      }
      $"current index" <- s9
      next s9 = w60
      next s10 = w63
      next s11 = w64
      next s12 = w65
      stop if w59
    }
    Array Size(array=w62) -> (size(s)=w98)
    Subtract(x=w34, y=w98) -> w99
    Array Subset(array=w33, length0=w99) -> w100
    Absolute Value(x=w100) -> w101
    $"Raw input" <- w101
    # w62: array to next fetch
    Absolute Value(x=w62)
    $"samples/symbol" <- w39
    Get Notifier Status(notifier=w14) -> (latest notification=w102, notifier out=w103)
    # asynchronous error notification
    call "NotifyError.gvi"(notifier ref=w103, Notify anyway=$Stop_RX_2)
    Tick Count() -> (timer value=w104)
    Subtract(x=w104, y=s8) -> w105
    Is Greater Than 0(x=s12) -> w106
    Select(s=w106, t=s12, f=1) -> w107
    Divide(x=w105, y=w107) -> w108
    Reciprocal(x=w108) -> w109
    Multiply(w109, 1000) -> w110
    $FPS <- w110
    $milliseconds <- w108
    $"dequeueing iteration" <- i2
    next s3 = w61
    next s4 = w27
    next s5 = s10
    next s6 = w62
    next s7 = s11
    next s8 = w104
    stop if w102
  }
  Release Queue(error in=s3, queue=s4) -> (error out=w111)
  call "niUSRP Abort.gvi"(session handle=w19, error in=w111) -> (session handle out=w112, error out=w113)
  call "niUSRP Close Session.gvi"(session handle=w112, error in=w113) -> (error out=w114)
  $"error out" <- w114
  $"actual IQ rate" <- w8
  $"actual carrier frequency" <- w9
  $"actual gain (dB)" <- w10
  # UDP sink
  call "Sink.gvi"(queue=w25, notifier ref=w14, error in=w24, net address_2="127.0.0.1", sink port=36363)
