vi "SFOSync.gvi"   [LabVIEW NXG 3.0.0]
inputs:
  "input signal": c128[]
  "error in": error
outputs:
  "output signal": c128[]
  "error out": error
panel indicators:
  "mean": f64
  "error out_2": error
  "correction angles": f64[]
uses:
  NI::Analysis::Conditioning::Unwrap Phase.gvi
  NI::Analysis::Statistics::Mean (DBL).gvi
  NI::Analysis::Generation::Ramp Pattern by Samples.gvi
diagram:
  Power Of X(x=2, y=$"input signal") -> w1
  Complex To Polar(r * e^(i*theta)=w1) -> (theta=w2)
  Divide(x=w2, y=2) -> w3
  call "Unwrap Phase.gvi"(input phase=w3, error in=$"error in") -> (unwrapped phase=w4, error out=w5)
  call "Mean (DBL).gvi"(x=w4, error in=w5) -> (mean=w6, error out=w7)
  $mean <- w6
  $"error out" <- w7
  Array Size(array=$"input signal") -> (size(s)=w8)
  Multiply(0, w8) -> w9
  # create phase compensation array
  call "Ramp Pattern by Samples.gvi"(samples=w8, end=w9) -> (ramp pattern=w10, error out=w11)
  Negate(x=w10) -> w12
  Polar To Complex(r=1, theta=w12) -> (r * e^(i*theta)=w13)
  # compensate by multiplying with e^-j(n*phase/sub code length)
  Multiply($"input signal", w13) -> w14
  $"output signal" <- w14
  $"error out_2" <- w11
