vi "Sink.gvi"   [LabVIEW NXG 3.0.0]
inputs:
  "error in": error
  "queue": Queue<u8[]>, required
  "sink port": u16 = 36363, required
  "net address_2": string = "127.0.0.1", required
  "notifier ref": Notifier<bool>, required
  "Pack bits": bool = TRUE
outputs:
  "sent output": u8[]
  "error out": error
panel indicators:
  "sink iteration": i32
uses:
  NI::Modulation::MT Pack Bits.gvi
diagram:
  Udp Open(error in=$"error in", net address=$"net address_2", port=0) -> (connection ID=w1, error out=w2)
  s1 = w2  # shift register
  s2 = w1  # shift register
  s3 = $queue  # shift register
  while (iteration -> i1) {
    Get Notifier Status(notifier=$"notifier ref") -> (latest notification=w3)
    case (w3) {
      frame False, Default {
        Dequeue Element(error in=s1, queue=s3, timeout in ms=100) -> (element=w7, error out=w8, queue out=w4)
        Array Size(array=w7) -> (size(s)=w9)
        Is Greater Than 0(x=w9) -> w10
        case (w10) {
          frame False, Default {
            w11 = w8
            w12 = u8[] []
            w6 = s2
          }
          frame True {
            # Pack bit stream into bytes
            case ($"Pack bits") {
              frame False, Default {
                w13 = w8
                w12 = w7
              }
              frame True {
                call "MT Pack Bits.gvi"(input bit stream=w7, bits per integer=8, packed bit order="MSB first", integer format="Unsigned", error in=w8) -> (output integers=w14, error out=w13)
                To Unsigned Byte Integer(number=w14) -> w12
              }
            }
            # Send packets over UDP
            Udp Write Binary(address=$"net address_2", connection ID=s2, data in=w12, error in=w13, port or service name=$"sink port", timeout ms=100) -> (connection ID out=w6, error out=w11)
          }
        }
        call "NotifyError.gvi"(notifier ref=$"notifier ref", error in=w11) -> (Error out=w5)
        $"sent output" <- w12
      }
      frame True {
        w4 = s3
        w5 = s1
        w6 = s2
      }
    }
    $"sink iteration" <- i1
    next s1 = w5
    next s2 = w6
    next s3 = w4
    stop if w3
  }
  Udp Close(connection ID=s2, error in=s1) -> (error out=w15)
  $"error out" <- w15
