vi "decode.gvi"   [LabVIEW NXG 3.0.0]
inputs:
  "input data": i32[]
  "error in": error
  "code type": enum{"reed-solomon", "convolutional", "no code"} = "convolutional"
  "convolutional rate": enum{"1/2", "1/3", "1/4", "2/3", "3/4"} = "1/2"
  "convolutional constraint length": i32 = 3
  "traceback depth": i32 = 15
  "RS code word length (n), symbols": i32 = 7
  "RS data word length (k), symbols": i32 = 3
outputs:
  "output bit stream": i32[]
  "error out": error
uses:
  NI::Modulation::MT RS Symbol Decoder (normal).gvi
  NI::Modulation::MT Convolutional Decoder (Viterbi Soft Decision, Rate).gvi
diagram:
  case ($"code type") {
    frame "reed-solomon", Default {
      call "MT RS Symbol Decoder (normal).gvi"(input symbols=$"input data", code word length (n), symbols=$"RS code word length (n), symbols", data word length (k), symbols=$"RS data word length (k), symbols", error in=$"error in") -> (output symbols=w2, error out=w1)
    }
    frame "convolutional" {
      call "MT Convolutional Decoder (Viterbi Soft Decision, Rate).gvi"(input integers=$"input data", rate=$"convolutional rate", constraint length=$"convolutional constraint length", error in=$"error in", traceback depth=$"traceback depth") -> (output bit stream=w2, error out=w1)
    }
    frame "no code" {
      w1 = $"error in"
      w2 = $"input data"
    }
  }
  $"output bit stream" <- w2
  $"error out" <- w1
