vi "System test_v2.gvi"   [LabVIEW NXG 3.0.0]
panel controls:
  "Barker insert index": i32 = 64
  "filter parameter": f64 = 0.5
  "filter length": i32 = 8
  "IQ rate": f64 = 160000
  "Symbol rate (sym/s)": i32 = 10000
  "ChannelConfig": T2 = {20, 1, 16, 0, 1, 10000}
  "message length (symbols)": i32 = 128
  "Min correlation": f64 = 0.9
  "Frame sync": bool
  "Channel": bool
  "Stop": bool
  "Barker code": enum{"5", "7", "11", "random"} = "random"
  "Freq sync": bool
  "decode": bool
  "Padding length": i32 = 5
  "encode": bool
  "Interleaver": bool
  "Receive sound": bool
  "Send sound": bool
  "source port": u16 = 26363
  "net address": string = "127.0.0.1"
  "sink port": u16 = 36363
  "Reset BER": bool
  "sync frame buffer (symbols)": i32 = 16
  "Reset MSE": bool
panel indicators:
  "IQ diagram": c128[]
  "Baseband signal (real part)": cluster{"t0": f64, "dt": f64, "Y": f64[]}
  "Input bit stream": u8[]
  "IQ diagram_2": c128[]
  "Correlation": f64[]
  "error out": error
  "symbols downsampled": f64[]
  "number elements in queue": i32
  "actual message length": i32
  "Transmitting": bool
  "Output": string
  "input": string
  "BER graph": f64[]
  "Mean_BER": f64
  "current BER": f64
  "Input array size": i32
  "Output array size": i32
  "Correct Size": bool
  "x < y?": bool
  "output array": u8[]
  "Accumulated MSE": f64
  "MSE Graph": f64[]
types:
  T1 = cluster{"Eb/No": f64, "bits per symbol": i32, "samples per symbol": i32}
  T2 = cluster{"Noise": T1, "Frequency offset": cluster{"Frequency offset": f64}, "Timing": cluster{"Relation to fs": f64}, "Sampling rate": cluster{"fs": f64}}
uses:
  NI::Modulation::MT Pack Bits.gvi
  NI::G Core::Error::Display Error.gvi
diagram:
  Obtain Notifier(element data type=bool TRUE, name="error") -> (error out=w1, notifier out=w2)
  Obtain Queue(element data type=u8[] [], error in=w1) -> (error out=w3, queue out=w4)
  Obtain Queue(element data type=u8[] []) -> (queue out=w5)
  s1 = uninitialised  # shift register
  s2 = uninitialised  # shift register
  while {
    # Bits??
    case ($"Send sound") {
      frame False, Default {
        call "Example signal.gvi"(message length (bits)=$"message length (symbols)") -> (output bit stream=w6)
      }
      frame True {
        Get Queue Status(queue=w4) -> (# elements in queue=w7)
        $"number elements in queue" <- w7
        Dequeue Element(queue=w4, timeout in ms=100) -> (element=w6)
      }
    }
    Array Size(array=w6) -> (size(s)=w8)
    $"actual message length" <- w8
    Is Less(x=w8, y=256) -> w9
    $"x < y?" <- w9
    Subtract(x=$"message length (symbols)", y=w8) -> w10
    call "ZeroPaddingInt.gvi"(Input=w6, Padding length=w10, samples per symbol=1, pad beginning=FALSE, pad end=TRUE) -> (output array=w11)
    case (w9) {
      frame False, Default { }
      frame True {
        $"output array" <- w11
      }
    }
    Is Greater(x=w8, y=0) -> w12
    case (w12) {
      frame False, Default {
        w13 = w3
        w14 = s1
        w15 = s2
      }
      frame True {
        call "Transmitter.gvi"(filter parameter=$"filter parameter", filter length=$"filter length", Interleaver=$Interleaver, input bit stream=w11, IQ rate=$"IQ rate", Symbol rate (sym/s)=$"Symbol rate (sym/s)", Frame sync=$"Frame sync", error in=w3, Barker code=$"Barker code", Barker insert index=$"Barker insert index", encode=$encode) -> (signal out=w16, IQ diagram=w17, error out=w18)
        $"IQ diagram" <- w17
        Divide(x=1, y=$"Symbol rate (sym/s)") -> w19
        Divide(x=$"IQ rate", y=$"Symbol rate (sym/s)") -> w20
        call "ZeroPaddingDbl.gvi"(Input=w16, Padding length=$"Padding length", samples per symbol=w20) -> (output array=w21)
        Build Cluster(0, w19, w21) -> w22
        case ($Channel) {
          frame False, Default {
            w23 = w22
            w24 = w18
          }
          frame True {
            call "Channel_basic.gvi"(inputSignal=w22, ChannelConfig=$ChannelConfig, error in=w18) -> (signalOutput=w23, error out=w24)
          }
        }
        Property Node(instance in=w23) -> ("Element 3"=w25)
        call "PulseShaping.gvi"(Signal in=w25, Samples per symbol=w20, filter parameter=$"filter parameter", filter length=$"filter length", tx or rx="Rx") -> (signal out=w26)
        call "Receiver.gvi"(Interleaver=$Interleaver, sync frame buffer (symbols)=$"sync frame buffer (symbols)", Signal in=w26, IQ rate=$"IQ rate", Symbol rate (sym/s)=$"Symbol rate (sym/s)", Min correlation=$"Min correlation", error in=w24, message length (symbols)=$"message length (symbols)", sync frame index (symbols)=$"Barker insert index", barker code=$"Barker code", Frame sync=$"Frame sync", Freq sync=$"Freq sync", decoding=$decode) -> (IQ diagram=w27, Symbols downsampled (real)=w28, output bit stream=w29, Correlation=w30, Baseband signal (real part)=w31, error out=w32)
        Absolute Value(x=w30) -> w33
        $Correlation <- w33
        case ($"Receive sound") {
          frame False, Default {
            call "BER.gvi"(Output bit stream=w29, Input bit stream=w11, Array in=s1, error in=w32, Reset BER=$"Reset BER") -> (Correct Size=w39, Output array size=w38, Input array size=w37, current BER=w36, Mean_BER=w35, BER graph=w34, BER array=w14, error out=w13)
            call "MSE.gvi"(Reset MSE=$"Reset MSE", IQ Input signal=w27, IQ Reference signal=w17, Array in=s2) -> (Accumulated MSE=w40, MSE Array=w15)
          }
          frame True {
            Array Size(array=w29) -> (size(s)=w41)
            Is Greater Than 0(x=w41) -> w42
            case (w42) {
              frame False, Default { }
              frame True {
                call "MT Pack Bits.gvi"(input bit stream=w6, bits per integer=8, packed bit order="MSB first", integer format="Unsigned") -> (output integers=w43)
                Byte Array To String(encoding="Extended ASCII", unsigned byte array=w43) -> (string=w44)
                $input <- w44
                call "MT Pack Bits.gvi"(input bit stream=w29, bits per integer=8, packed bit order="MSB first", integer format="Unsigned") -> (output integers=w45)
                Byte Array To String(encoding="Extended ASCII", unsigned byte array=w45) -> (string=w46)
                $Output <- w46
              }
            }
            call "BER.gvi"(Output bit stream=w29, Input bit stream=w6, Array in=s1, error in=w32, Reset BER=$"Reset BER") -> (Correct Size=w39, Output array size=w38, Input array size=w37, current BER=w36, Mean_BER=w35, BER graph=w34, BER array=w14, error out=w47)
            Enqueue Element(element=w29, error in=w47, queue=w5) -> (error out=w13)
            call "MSE.gvi"(IQ Input signal=w27, IQ Reference signal=w17, Array in=s2) -> (Accumulated MSE=w40, MSE Array=w15)
          }
        }
        $"current BER" <- w36
        $Mean_BER <- w35
        $"BER graph" <- w34
        $"Baseband signal (real part)" <- w31
        $"symbols downsampled" <- w28
        $"Input array size" <- w37
        $"IQ diagram_2" <- w27
        $"Output array size" <- w38
        $"Correct Size" <- w39
        $"Input bit stream" <- w11
        $"Accumulated MSE" <- w40
        $"MSE Graph" <- w15
      }
    }
    $"error out" <- w13
    $Transmitting <- w12
    call "Display Error.gvi"(error in=w13) -> (error?=w48)
    Get Notifier Status(notifier=w2) -> (latest notification=w49)
    Logical Or($Stop, w49) -> w50
    Logical Or(w48, w50) -> w51
    next s1 = w14
    next s2 = w15
    stop if w51
  }
  call "Source.gvi"(queue=w4, notifier ref=w2, error in=w3, net address=$"net address", source port=$"source port")
  call "Sink.gvi"(queue=w5, notifier ref=w2, net address_2=$"net address", sink port=$"sink port")
