vi "TestFreqSync.gvi"   [LabVIEW NXG 3.0.0]
panel controls:
  "message length (bits)": i32 = 1000
  "Samples per symbol": i32 = 16
  "frame insert index": i32
  "Insert frame": bool
  "Error in": error
  "padding bits": i32
  "Min correlation threshold": f64
  "compensate": bool
  "frequency offset": f64
  "Barker code": enum{"5", "7", "11", "random"} = "random"
  "phase offset_2": f64
panel indicators:
  "error out_2": error
  "BER": f64
  "output bit stream": i8[]
  "estimated phase drift": f64
  "correlation": f64[]
  "actual phase drift": f64
  "intercept": f64
  "source bit stream": i8[]
  "after compensation": f64[]
  "before compensation": f64[]
  "estimated phase offset": f64
  "IQ diagram after": c128[]
  "IQ diagram before": c128[]
  "RMSE of angles": f64
  "Angle errors": f64[]
uses:
  NI::Analysis::Statistics::Mean (DBL).gvi
  NI::Analysis::Statistics::RMS (DBL).gvi
diagram:
  call "TestSync.gvi"(message length (bits)=$"message length (bits)", Samples per symbol=$"Samples per symbol", frame insert index=$"frame insert index", Insert frame=$"Insert frame", Error in=$"Error in", frequency offset=$"frequency offset", phase offset=$"phase offset_2", Barker code=$"Barker code", Min correlation threshold=$"Min correlation threshold", padding bits=$"padding bits") -> (framesync output=w1, Training Subcodes=w2, Graph=w3, source bit stream=w4, error out=w5, phase drift=w6)
  case ($compensate) {
    frame False, Default {
      w7 = w5
      w8 = w1
      w9 = 0
      w10 = 0
      w11 = 0
      w12 = f64[] []
      w13 = c128[] []
    }
    frame True {
      call "FreqSync.gvi"(input=w1, Training codes=w2, Samples per symbol=$"Samples per symbol", Frame index=$"frame insert index", error in=w5, barker code=$"Barker code") -> (correction angles=w12, output=w8, phase drift=w9, intercept=w10, phase offset=w11, error out=w7)
      w13 = w1
    }
  }
  $"IQ diagram after" <- w8
  Complex To Real Imaginary(x + iy=w8) -> (x=w14)
  $"after compensation" <- w14
  $"IQ diagram before" <- w1
  Complex To Real Imaginary(x + iy=w1) -> (x=w15)
  $"before compensation" <- w15
  $correlation <- w3
  call "RemoveSyncFrame.gvi"(input=w8, samples per symbol=$"Samples per symbol", sync frame index (bits)=$"frame insert index", barker code=$"Barker code") -> (output=w16)
  call "Downsampler.gvi"(input signal=w16, error in=w7, samples per symbol=$"Samples per symbol") -> (output signal=w17, error out=w18)
  case (w18) {
    frame Error, Default {
      w19 = w18
      w20 = i8[] []
    }
    frame No Error {
      call "BPSKDemod.gvi"(symbols=w17, error in=w18) -> (output bit stream=w20, error out=w19)
    }
  }
  Array Subset(array=w20, length0=$"message length (bits)") -> w21
  Is Not Equal(x=w4, y=w21) -> w22
  Boolean To Integer(Boolean=w22) -> (0, 1=w23)
  # Calculate BER
  case (w19) {
    frame Error, Default {
      w24 = w19
      w25 = -1
    }
    frame No Error {
      call "Mean (DBL).gvi"(x=w23, error in=w19) -> (mean=w25, error out=w24)
    }
  }
  $BER <- w25
  $"error out_2" <- w24
  $"estimated phase drift" <- w9
  $intercept <- w10
  $"actual phase drift" <- w6
  $"estimated phase offset" <- w11
  $"output bit stream" <- w21
  $"source bit stream" <- w4
  Complex To Polar(r * e^(i*theta)=w13) -> (theta=w26)
  Subtract(x=w26, y=w12) -> w27
  $"Angle errors" <- w27
  call "RMS (DBL).gvi"(x=w27) -> (rms value=w28)
  $"RMSE of angles" <- w28
