vi "TestSource.gvi"   [LabVIEW NXG 3.0.0]
panel controls:
  "error in": error
  "stop": bool
  "port": u16 = 36363
  "net address": string = "127.0.0.1"
  "error in_2": error
  "stop_2": bool
panel indicators:
  "Error out": error
  "element": u8[]
uses:
  source.mli::source matlab
  sink.mli::sink matlab
diagram:
  Obtain Queue(element data type=u8[] []) -> (queue out=w1)
  Obtain Queue(element data type=u8[] []) -> (queue out=w2)
  s1 = w1  # shift register
  s2 = uninitialised  # shift register
  s3 = $"error in"  # shift register
  s4 = w2  # shift register
  while {
    call "Source.gvi"(queue in=s1, last message=s2, error in=s3) -> (queue out_2=w3, current messsage=w4, error out=w5)
    Enqueue Element(element=w4, queue=s4) -> (queue out=w6)
    $element <- w4
    Logical Or(w5, $stop) -> w7
    next s1 = w3
    next s2 = w4
    next s3 = w5
    next s4 = w6
    stop if w7
  }
  w8 = $port
  w9 = $"net address"
  Udp Open(error in=$"error in_2", net address=w9, port=w8) -> (connection ID=w10)
  s5 = $"error in"  # shift register
  s6 = w10  # shift register
  s7 = w2  # shift register
  while {
    call "Sink.gvi"(queue=s7, connection ID in=s6, error in=s5, net address=w9, port=w8) -> (queue out=w11, connection ID out=w12, error out_2=w13)
    Logical Or(w13, $stop_2) -> w14
    next s5 = w13
    next s6 = w12
    next s7 = w11
    stop if w14
  }
  Udp Close(connection ID=s6)
  # Call matlab script
  $"Error out" <- s5
  disable {
    frame Disabled {
      call "source matlab"() -> (data=w15)
      call "sink matlab"(data=w15)
    }
    frame Enabled { }
  }
