vi "TestSync.gvi"   [LabVIEW NXG 3.0.0]
inputs:
  "message length (bits)": i32 = 88
  "Error in": error
  "Samples per symbol": i32 = 16
  "frame insert index": i32 = 44
  "Barker code": enum{"5", "7", "11", "random"} = "random"
  "Min correlation threshold": f64
  "padding bits": i32 = 50
  "Insert frame": bool
  "frequency offset": f64
  "phase offset": f64
outputs:
  "Training Subcodes": c128[]
  "framesync output": c128[]
  "error out": error
  "Graph": f64[]
  "source bit stream": i8[]
  "phase drift": f64
  "channel": c128[]
panel controls:
  "sync frame buffer (symbols)": i32 = 16
panel indicators:
  "BER": f64
  "output bit stream": i8[]
  "max index(es)": i32
  "Index should be at": i32
uses:
  NI::Modulation::MT Generate Bits (Fibonacci, PN Order).gvi
  NI::Analysis::Generation::Ramp Pattern by Samples.gvi
  NI::Analysis::Statistics::Mean (DBL).gvi
diagram:
  Multiply(6.28, $"frequency offset") -> w1
  # optional carrier frequency shift
  $"phase drift" <- w1
  Multiply($"padding bits", $"Samples per symbol") -> w2
  Initialize Array(element=0+0i, size=w2) -> w3
  Random Number() -> (number (0 to 1)=w4)
  Multiply(w4, 1000) -> w5
  To Long Integer(number=w5) -> w6
  call "MT Generate Bits (Fibonacci, PN Order).gvi"(total bits=$"message length (bits)", PN sequence order=10, seed in=w6, error in=$"Error in") -> (output bit stream=w7, error out=w8)
  call "BPSKMod.gvi"(input bit stream=w7, error in=w8) -> (Symbol out=w9, error out=w10)
  case ($"Insert frame") {
    frame False, Default {
      w11 = w9
    }
    frame True {
      call "SyncFrameInserter.gvi"(Signal in=w9, insert index=$"frame insert index", Barker code=$"Barker code") -> (Signal out=w11)
    }
  }
  call "Upsampler.gvi"(Signal in=w11, Samples per symbol=$"Samples per symbol", error in=w10) -> (Upsampled signal=w12, error out=w13)
  Insert Into Array(inArray=w12, index0=0, new=w3) -> w14
  Array Size(array=w14) -> (size(s)=w15)
  Insert Into Array(inArray=w14, index0=w15, new=w3) -> w16
  # add padding before and after message to simulate a IQ fetch
  call "PulseShaping.gvi"(Signal in=w16, Samples per symbol=$"Samples per symbol", tx or rx="Tx") -> (signal out=w17)
  call "PulseShaping.gvi"(Signal in=w17, Samples per symbol=$"Samples per symbol", tx or rx="Rx") -> (signal out=w18)
  call "NormalizeVector.gvi"(Vector=w18) -> (Normalized Vector=w19)
  $channel <- w19
  Multiply($"frame insert index", $"Samples per symbol") -> w20
  Add(w2, w20) -> w21
  $"Index should be at" <- w21
  Array Size(array=w19) -> (size(s)=w22)
  Multiply(w1, w22) -> w23
  call "Ramp Pattern by Samples.gvi"(samples=w22, end=w23) -> (ramp pattern=w24)
  Add($"phase offset", w24) -> w25
  Polar To Complex(r=1, theta=w25) -> (r * e^(i*theta)=w26)
  Multiply(w19, w26) -> w27
  call "FrameSync.gvi"(input signal=w27, samples per symbol=$"Samples per symbol", sync frame buffer (symbols)=$"sync frame buffer (symbols)", error in=w13, sync frame index (symbols)=$"frame insert index", barker code=$"Barker code", Min correlation=$"Min correlation threshold") -> (output signal=w28, Correlation=w29, max index=w30, Training Subcodes=w31, error out=w32)
  call "RemoveSyncFrame.gvi"(input=w28, samples per symbol=$"Samples per symbol", sync frame index (bits)=$"frame insert index", barker code=$"Barker code") -> (output=w33)
  call "Downsampler.gvi"(input signal=w33, error in=w32, samples per symbol=$"Samples per symbol") -> (output signal=w34, error out=w35)
  case (w35) {
    frame Error, Default {
      w36 = w35
      w37 = i8[] []
    }
    frame No Error {
      call "BPSKDemod.gvi"(symbols=w34, error in=w35) -> (output bit stream=w37, error out=w36)
    }
  }
  Array Subset(array=w37, length0=$"message length (bits)") -> w38
  Is Not Equal(x=w7, y=w38) -> w39
  Boolean To Integer(Boolean=w39) -> (0, 1=w40)
  # Calculate BER
  case (w36) {
    frame Error, Default {
      w41 = w36
      w42 = -1
    }
    frame No Error {
      call "Mean (DBL).gvi"(x=w40, error in=w36) -> (mean=w42, error out=w41)
    }
  }
  $BER <- w42
  $"framesync output" <- w28
  $"source bit stream" <- w7
  $"error out" <- w41
  $"Training Subcodes" <- w31
  $"max index(es)" <- w30
  $"output bit stream" <- w38
  Absolute Value(x=w29) -> w43
  $Graph <- w43
