vi "TestUDP.gvi"   [LabVIEW NXG 3.0.0]
panel controls:
  "error in": error
  "source port": u16 = 26363
  "net address_2": string = "127.0.0.1"
  "sink port": u16 = 36363
panel indicators:
  "Error out": error
  "string": string
  "size(s)": i32
uses:
  NI::Modulation::MT Pack Bits.gvi
  NI::G Core::Error::Multiplex Errors.gvi
diagram:
  Obtain Queue(element data type=u8[] []) -> (queue out=w1)
  Obtain Notifier(element data type=bool TRUE, error in=$"error in", name="error") -> (error out=w2, notifier out=w3)
  Obtain Queue(element data type=u8[] []) -> (queue out=w4)
  while {
    Dequeue Element(queue=w1) -> (element=w5)
    Array Size(array=w5) -> (size(s)=w6)
    $"size(s)" <- w6
    Is Greater Than 0(x=w6) -> w7
    case (w7) {
      frame False, Default { }
      frame True {
        call "MT Pack Bits.gvi"(input bit stream=w5, bits per integer=8, packed bit order="MSB first", integer format="Unsigned") -> (output integers=w8)
        Byte Array To String(encoding="Extended ASCII", unsigned byte array=w8) -> (string=w9)
        $string <- w9
      }
    }
    Get Notifier Status(notifier=w3) -> (latest notification=w10)
    Enqueue Element(element=w5, queue=w4)
    stop if w10
  }
  call "Source.gvi"(queue=w1, notifier ref=w3, error in=w2, net address=$"net address_2", source port=$"source port") -> (error out=w11)
  call "Sink.gvi"(queue=w4, notifier ref=w3, error in=w2, net address_2=$"net address_2", sink port=$"sink port") -> (error out=w12)
  call "Multiplex Errors.gvi"(error in 1=w12, error in 2=w11) -> (error out=w13)
  Release Notifier(error in (no error)=w13, notifier=w3) -> (error out=w14)
  $"Error out" <- w14
