vi "Source.gvi"   [LabVIEW NXG 3.0.0]
inputs:
  "queue": Queue<u8[]>
  "error in": error
  "source port": u16 = 26363
  "net address": string = "127.0.0.1"
  "packet length(bits)": u32 = 26363
  "notifier ref": Notifier<bool>
outputs:
  "error out": error
  "element": u8[]
panel controls:
  "pack bits": bool = TRUE
panel indicators:
  "source iteration": i32
uses:
  NI::Modulation::MT UnPack Bits.gvi
  NI::G Core::Error::Filter Error Code.gvi
diagram:
  w1 = $"pack bits"
  Udp Open(error in=$"error in", net address=$"net address", port=$"source port") -> (connection ID=w2, error out=w3)
  s1 = w3  # shift register
  s2 = $queue  # shift register
  s3 = w2  # shift register
  s4 = $"notifier ref"  # shift register
  while (iteration -> i1) {
    Get Notifier Status(notifier=s4) -> (latest notification=w4)
    case (w4) {
      frame True {
        w5 = s3
        w6 = s1
        w7 = s4
        w8 = s2
      }
      frame False {
        Udp Read I Pv 6 Binary(connection ID=s3, error in=s1, timeout ms=100) -> (connection ID out=w5, data out=w9, error out=w10)
        case (w1) {
          frame False, Default {
            w11 = w9
            w12 = w10
          }
          frame True {
            call "MT UnPack Bits.gvi"(input integers=w9, bits per integer=8, packed bit order="LSB first", integer format="Unsigned", error in=w10) -> (output bit stream=w11, error out=w12)
          }
        }
        Enqueue Element(element=w11, error in=w12, queue=s2) -> (error out=w13, queue out=w8)
        call "Filter Error Code.gvi"(error in=w13, code to clear=56) -> (error out=w14)
        call "NotifyError.gvi"(notifier ref=s4, error in=w14) -> (Error out=w6)
        $element <- w9
        w7 = s4
      }
    }
    $"source iteration" <- i1
    next s1 = w6
    next s2 = w8
    next s3 = w5
    next s4 = w7
    stop if w4
  }
  Udp Close(connection ID=s3, error in=s1) -> (error out=w15)
  $"error out" <- w15
