vi "Transmitter.gvi"   [LabVIEW NXG 3.0.0]
inputs:
  "input bit stream": i8[]
  "error in": error
  "IQ rate": f64
  "Barker code": enum{"5", "7", "11", "random"} = "random"
  "Barker insert index": i32
  "filter parameter": f64 = 0.5
  "filter length": i32 = 8
  "Symbol rate (sym/s)": i32
  "Frame sync": bool = TRUE
  "encode": bool
  "Interleaver": bool
outputs:
  "signal out": c128[]
  "error out": error
  "IQ diagram": c128[]
  "total bit length": i32
panel controls:
  "code type": enum{"reed-solomon", "convolutional", "no code"} = "convolutional"
  "RS code word length (n), symbols": i32 = 7
  "RS data word length (k), symbols": i32 = 3
  "convolutional rate": enum{"1/2", "1/3", "1/4", "2/3", "3/4"} = "1/2"
  "convolutional constraint length": i32 = 3
diagram:
  Divide(x=$"IQ rate", y=$"Symbol rate (sym/s)") -> w1
  # Encoding
  case ($encode) {
    frame False, Default {
      w2 = $"input bit stream"
      w3 = $"error in"
    }
    frame True {
      call "encode.gvi"(convolutional rate=$"convolutional rate", convolutional constraint length=$"convolutional constraint length", input bit stream=$"input bit stream", error in=$"error in", code type=$"code type", RS code word length (n), symbols=$"RS code word length (n), symbols", RS data word length (k), symbols=$"RS data word length (k), symbols") -> (data out=w2, error out=w3)
    }
  }
  Array Size(array=w2) -> (size(s)=w4)
  # 2*Traceback depth fra Decoder
  Initialize Array(element=0, size=30) -> w5
  Insert Into Array(inArray=w2, index0=w4, new=w5) -> w6
  # Interleaving
  case ($Interleaver) {
    frame False, Default {
      w7 = w6
      w8 = w3
    }
    frame True {
      call "Interleaver.gvi"(data in=w6, error in=w3, selector="TX") -> (data out=w7, error out=w8)
    }
  }
  # Symbol mapping
  call "BPSKMod.gvi"(input bit stream=w7, error in=w8) -> (Symbol out=w9, error out=w10)
  # Add frame sync
  case ($"Frame sync") {
    frame False, Default {
      w11 = w9
    }
    frame True {
      call "SyncFrameInserter.gvi"(Signal in=w9, insert index=$"Barker insert index", Barker code=$"Barker code") -> (Signal out=w11)
    }
  }
  call "Upsampler.gvi"(Signal in=w11, Samples per symbol=w1, error in=w10) -> (Upsampled signal=w12, error out=w13)
  # Upsample
  # Pulse shaping
  call "PulseShaping.gvi"(Signal in=w12, Samples per symbol=w1, filter parameter=$"filter parameter", filter length=$"filter length", error in=w13, tx or rx="Tx") -> (signal out=w14, error out=w15)
  $"signal out" <- w14
  $"error out" <- w15
  $"total bit length" <- w4
  $"IQ diagram" <- w9
